# Grasshopper definition design_iterations.gh (Grasshopper 1.0.8)

# ---- group: DESIGN
point_spacing_mm = Slider(6, range=1..50)  # disabled
layer_height_mm = Slider(1, range=0.5..10)  # disabled
height_mm = Slider(50, range=1..500)  # disabled
radius_mm = Slider(50, range=5..200)  # disabled

center_x_mm = Slider(0, range=-500..500)  # disabled
center_y_mm = Slider(0, range=-500..500)  # disabled
fine_adjust_z_mm = Slider(0, range=-5..5)  # disabled

# design: "slice" a cylinder
slice_cylinder = SliceCylinder(
    radius=radius_mm,
    height=height_mm,
    layer_height=layer_height_mm,
    point_spacing=point_spacing_mm,
    center_x=center_x_mm,
    center_y=center_y_mm,
    fine_adjust_z=fine_adjust_z_mm)  # -> layers; disabled
# ---------- slice_cylinder: Python ----------
# r: compas
# venv: mas-2627
"""
Slice a cylinder into layers, in work object coordinates (Rhino world XY = work object).
One closed compas Polyline per layer. Units: mm.
center_x, center_y: where the cylinder stands on the work object.
fine_adjust_z: shifts all layers up/down, to tune the nozzle height above the bed (0 = first layer at z = 0).
"""
import math

from compas.geometry import Point
from compas.geometry import Polyline

# ===== How many layers, how many points per layer =====
layer_count = int(height / layer_height)
points_per_layer = round(2 * math.pi * radius / point_spacing)

# ===== One closed polyline per layer =====
layers = []
for i in range(layer_count):
    z = i * layer_height + fine_adjust_z
    points = []
    for j in range(points_per_layer + 1):  # one extra point: back to the start to close the ring
        angle = 2 * math.pi * (j % points_per_layer) / points_per_layer
        points.append(Point(center_x + radius * math.cos(angle), center_y + radius * math.sin(angle), z))
    layers.append(Polyline(points))
# ---------- end slice_cylinder ----------

# ---- group: PRINTPATH
# generate printpath: printpoints and path
safety_distance_mm = Slider(100, range=10..300)  # disabled
blend_radius_mm = Slider(0.5, range=0..5)  # disabled
speed_mm_s = Slider(10, range=1..50)  # disabled
printpath = Printpath(layers=slice_cylinder, speed=speed_mm_s, blend_radius=blend_radius_mm, safety_distance=safety_distance_mm)  # -> printpath, summary; inputs layers: list; disabled
# ---------- printpath: Python ----------
# r: compas
# venv: mas-2627
"""
Turn the layers into printpoints and a PrintPath, in work object coordinates.
Safety points are added here, before any transform to the robot base.
"""
import os
import sys

from compas.geometry import Frame, Vector


# Find source folder
gh_dir = os.path.dirname(ghenv.Component.OnPingDocument().FilePath)
src_dir = os.path.join(gh_dir, "..", "..", "src")
if src_dir not in sys.path:
    sys.path.append(src_dir)
from print_class import PrintPoint, PrintPath

# ===== One printpoint per point =====
# world XY orientation for every point: a tangent frame would turn the wrist 360 degrees each layer
printpoints = []
for layer_index, layer in enumerate(layers):
    for point in layer.points:
        frame = Frame(point, -Vector.Xaxis(), Vector.Yaxis())
        printpoints.append(PrintPoint(frame, layer_index, speed, blend_radius, True))

# ===== Path with a travel point above the start and the end =====
printpath = PrintPath(printpoints)
printpath.add_safety_before(safety_distance, speed)
printpath.add_safety_after(safety_distance, speed)

summary = f"{len(printpoints)} printpoints in {len(layers)} layers, plus 2 safety points"
# ---------- end printpath ----------
panel = Panel(printpath.summary)  # disabled

# ----
# parameters
number_slider = Slider(200, range=0..1000)
number_slider_2 = Slider(50, range=0..1000)
number_slider_3 = Slider(100, range=0..1000)
number_slider_4 = Slider(2.85, range=0..10)
number_slider_5 = Slider(50, range=0..1000)

# ---- group: This is needed only ONCE in the GH definition
enable_auto_reload = Python3Script()  # -> ok
# ---------- enable_auto_reload: Python ----------
"""
------------------------------
Using VS Code as Python editor
------------------------------

The simplest way to start using VS Code as our editor, is
to place our Python code in files located IN THE SAME FOLDER as our Grasshopper file.

After we have done that, we need 2 steps: 

1. Enable the COMPAS reloader on one component. This tells Grasshopper to watch for changes in the Pythoh files and reload if changed.
2. Every other component that uses Python code from external files needs to start with a method to ensure Grasshopper knows where to load the files from.

"""
# r: compas
# venv: mas-2627

from compas_rhino.devtools import DevTools
DevTools.enable_reloader()
# ---------- end enable_auto_reload ----------

# ----
# design: "slice" a cylinder
spiral = Python3Script(x_rad=number_slider_2, y_rad=number_slider_3, layer_h=number_slider_4, h=number_slider, resolution=number_slider_5)  # -> out, layer; inputs resolution: Int32
# ---------- spiral: Python ----------
import math as m
from compas.geometry import Point, Vector, Frame, Polyline

n_turns = int(h//layer_h)
d_ang = 2 * m.pi / resolution
d_h = h / (resolution * n_turns)

pts = [Point(
    x_rad * m.cos(d_ang * i), 
    y_rad * m.sin(d_ang * i),
    (i * d_h) + layer_h
    ) 
for i in range(n_turns * resolution)
]

layer = Polyline(pts)

# frames = [Frame(
#     p,
#     Vector.Xaxis(),
#     Vector.Yaxis()
# )
# for p in pts]
# ---------- end spiral ----------
draw = COMPASDraw(cg=spiral.layer)  # -> rg
#   port cg: The COMPAS geometry or datastructure to be drawn.
#   port rg: The Rhino geometry object.
# ---------- draw: Python ----------
# r: compas>=2.14.1
"""
Draws COMPAS geometry in Grasshopper.
"""

from typing import Any

import Grasshopper

from compas.scene import SceneObject


class CompasToRhinoGeometry(Grasshopper.Kernel.GH_ScriptInstance):
    def RunScript(self, cg):
        if not cg:
            return None

        return SceneObject(item=cg).draw()
# ---------- end draw ----------

spiral_2 = Python3Script(x_rad=number_slider_2, y_rad=number_slider_3, layer_h=number_slider_4, h=number_slider, resolution=number_slider_5)  # -> out, layer; inputs resolution: Int32; same code as spiral

# ----
# generate printpath: printpoints and path
speed_mm_s_2 = Slider(10, range=1..50)
blend_radius_mm_2 = Slider(0.5, range=0..5)
safety_distance_mm_2 = Slider(100, range=10..300)
printpath_2 = Printpath(layers=spiral.layer, speed=speed_mm_s_2, blend_radius=blend_radius_mm_2, safety_distance=safety_distance_mm_2)  # -> printpath, summary; inputs layers: list; same code as printpath
panel_2 = Panel(printpath_2.summary)

# ---- group: EXPORT
# export: preview and save
panel_3 = Panel("data/out_printpoints.json")
save = Button()
preview = Preview(printpath=printpath_2.printpath)  # -> path, travel, planes
# ---------- preview: Python ----------
# r: compas
# venv: mas-2627
"""
Draw the printpath: path = the whole polyline, travel = extruder-off segments,
safety = extruder-off points, axes = small x and y axis of each frame.
"""
import Rhino.Geometry as rg
from compas_rhino.conversions import frame_to_rhino_plane, point_to_rhino

AXIS_LENGTH = 5.0  # mm

points = printpath.printpoints
planes = [frame_to_rhino_plane(printpoint.frame) for printpoint in points]

# ===== Whole path =====
polyline = rg.Polyline()
for plane in planes:
    polyline.Add(plane.Origin.X, plane.Origin.Y, plane.Origin.Z)
path = polyline.ToPolylineCurve()

# ===== Extruder off: a segment prints only if both of its points have the extruder on =====
safety = [point_to_rhino(printpoint.frame.point) for printpoint in points if not printpoint.is_extruder_on]
travel = []
for i in range(len(points) - 1):
    if not (points[i].is_extruder_on and points[i + 1].is_extruder_on):
        travel.append(rg.Line(planes[i].Origin, planes[i + 1].Origin))
# ---------- end preview ----------
save_2 = Save(printpath=printpath_2.printpath, save=save, out_path=panel_3)  # -> status
# ---------- save_2: Python ----------
# r: compas
# venv: mas-2627
"""
On button press, write the printpath to data/out_printpoints.json next to this .ghx file.
send_to_robot.py reads that file.
"""
import json
import os

import scriptcontext as sc

gh_dir = os.path.dirname(ghenv.Component.OnPingDocument().FilePath)

# keep the last status in sticky, so the message survives the button being released
status_key = "save_status_" + str(ghenv.Component.InstanceGuid)

if save:
    if printpath is None:
        sc.sticky[status_key] = "nothing to save: no printpath"
    else:
        path = os.path.normpath(os.path.join(gh_dir, out_path))
        os.makedirs(os.path.dirname(path), exist_ok=True)
        with open(path, "w") as f:
            json.dump(printpath.to_dict(), f, indent=2)
        sc.sticky[status_key] = f"saved {len(printpath)} printpoints to {path}"

status = sc.sticky.get(status_key, "")
ghenv.Component.Message = "saved" if status.startswith("saved") else status
# ---------- end save_2 ----------
plane = Plane(preview.planes)
panel_4 = Panel(save_2)
preview_2 = CustomPreview(Geometry=preview.travel, Material=ColourSwatch(SwatchColor=RGB(230, 40, 40)))
preview_3 = CustomPreview(Geometry=preview.path, Material=ColourSwatch(SwatchColor=RGB(0, 170, 80)))
